# Grasshopper definition NASA competition Model.gh (Grasshopper 1.0.7)
# plug-ins: Pufferfish

volume = Volume()  # -> Volume, Centroid

# ---- group: Landing pods
crv = Curve(<curve referenced from the Rhino model>)
xz = XZPlane(Origin=Point(0, 0, 0))
neg = Negative(Value=Slider(480, range=0..1000))
number_slider = Slider(19000, range=0..100000)
X = UnitX(Factor=number_slider)
Y = UnitY(Factor=number_slider)

# ---- group: Landing pods / move geometry to center
end = EndPoints(Curve=crv)  # -> Start, End
pt = ConstructPoint(XCoordinate=0, YCoordinate=0, ZCoordinate=0)
move2pt = MoveToPoint(Geometry=crv, PointA=end.Start, PointB=pt)  # -> Moved, Vector, Transform

# ---- group: Landing pods (continued)
orient = Orient(Geometry=move2pt.Moved, Source=PlaneXY(0, 0, 0), Target=xz)  # -> Geometry, Transform
end_2 = EndPoints(Curve=orient.Geometry)  # -> Start, End
ln = Line(StartPoint=end_2.Start, EndPoint=end_2.End)
revsrf = Revolution(Curve=orient.Geometry, Axis=ln, Domain="0 To 2 * Pi")
offset = OffsetSurface(Surface=revsrf, Distance=neg, Retrim=True)
merge = Merge(Data1=revsrf, Data2=offset)
move = Move(Geometry=merge, Motion=X)  # -> Geometry, Transform
move_2 = Move(Geometry=move.Geometry, Motion=Y)  # -> Geometry, Transform
merge_2 = Merge(Data1=merge, Data2=move.Geometry, Data3=move_2.Geometry)
